# Dynamo graph Create BW View Filter.dyn (Dynamo 1.2.0.2690)

activeViewFromCurrentDocument = Custom[Document.ActiveViewFromCurrentDocument]()  # Gets the active view of the current document
boolean = BoolSelector(true)
code_block = CodeBlock { "3D PRINT8"; }
code_block_2 = CodeBlock { "HIDE CATEGORIES8"; }

# group: SELECT ALL CATEGORIES, HIDE DESIGNATED
python_script = Python(IN[0]=boolean, IN[1]=code_block, IN[2]=code_block_2)
# ---------- python_script.python (67 lines) ----------
# Copyright(c) 2016, Konrad K Sobon
# @arch_laboratory, http://archi-lab.net

import clr
clr.AddReference('ProtoGeometry')
from Autodesk.DesignScript.Geometry import *

# Import Element wrapper extension methods
clr.AddReference("RevitNodes")
import Revit
clr.ImportExtensions(Revit.Elements)

# Import geometry conversion extension methods
clr.ImportExtensions(Revit.GeometryConversion)

# Import DocumentManager and TransactionManager
clr.AddReference("RevitServices")
import RevitServices
from RevitServices.Persistence import DocumentManager
from RevitServices.Transactions import TransactionManager

doc = DocumentManager.Instance.CurrentDBDocument
uiapp = DocumentManager.Instance.CurrentUIApplication
app = uiapp.Application

# Import RevitAPI
clr.AddReference("RevitAPI")
import Autodesk
from Autodesk.Revit.DB import *

import System
from System import Array
from System.Collections.Generic import *

import sys
pyt_path = r'C:\Program Files (x86)\IronPython 2.7\Lib'
sys.path.append(pyt_path)


name = IN[1]
invisibleName = IN[2]

ignoreCategory = ["Callouts","Curtain Panels", "Detail Items", "Doors", "Electrical Equipment", "Electrical Fixtures", "Elevations", "Entourage", "Furniture","Furniture Systems", "Grids", "Levels", "Lighting Fixtures", "Mechanical Equipment", "Parking", "Planting", "Plumbing Fixtures", "Rooms", "Sections", "Specialty Equipment", "Windows", "Text Notes", "Lines", "Generic Annotation", "Room Separation"]

catList = List[ElementId]()
invisibleCatList = List[ElementId]()
for cat in doc.Settings.Categories:
	catList.Add(cat.Id)
	if cat.Name in ignoreCategory:
		invisibleCatList.Add(cat.Id)
rules = []
#rules = List[FilterRule]()

filter = None
if IN[0]:
	TransactionManager.Instance.EnsureInTransaction(doc)
	filter = ParameterFilterElement.Create(doc, name, catList, rules)
	TransactionManager.Instance.TransactionTaskDone()
	
invisibleFilter = None
if IN[0]:
	TransactionManager.Instance.EnsureInTransaction(doc)
	invisibleFilter = ParameterFilterElement.Create(doc, invisibleName, invisibleCatList, rules)
	TransactionManager.Instance.TransactionTaskDone()

#Assign your output to the OUT variable.
OUT = filter, invisibleFilter
# ----------------------------------------

code_block_3 = CodeBlock(x=python_script) { x[0]; x[1]; }
color_picker = nColorPicker()
code_block_4 = CodeBlock { 1; 6; 0; "Fine"; false; }
fill_patterns = FillPatternUI("Solid fill")
color_picker_2 = nColorPicker()
overrideGraphicsSetting = Views.View.OverrideGraphicsSetting(color_picker, code_block_4.out0, arg3=color_picker, arg4=fill_patterns, arg5=color_picker_2, arg6=code_block_4.out1, arg8=color_picker_2, arg9=fill_patterns, arg10=code_block_4.out2, arg11=code_block_4.out3, arg12=code_block_4.out4, lacing=CrossProduct)
setFilterOverrides = Views.View.SetFilterOverrides(activeViewFromCurrentDocument, code_block_3.out0, overrideGraphicsSetting)
boolean_2 = BoolSelector(false)
setFilterVisibility = Views.View.SetFilterVisibility(activeViewFromCurrentDocument, code_block_3.out1, boolean_2)
