# Dynamo graph GrabScopeBoxAndView.dyn (Dynamo 1.2.1.3083)

# group: Grab Scope Box by Name
scopebox_collector = Custom[ScopeBox Collector]()  # Gets Scope boxes from document. Output Elements, Names and Count
watch = Watch(scopebox_collector.Elements)
watch_2 = Watch(scopebox_collector.Names)
code_block = CodeBlock { "Scope Box for 3D Printing"; }
eq = watch_2 == code_block
filterByBoolMask = List.FilterByBoolMask(list=watch, mask=eq)
watch_3 = Watch(filterByBoolMask.in)

# group: Create Section by "Scope Box"
get_views_by_type = Custom[Get Views By Type]()  # Get all views in the project classified by type
scope_boxes_to_views = Custom[Scope Boxes to Views](Views=get_views_by_type.sections, ScopeBoxes=watch_3)  # Create as many dependent view as needed to selected views to apply selected Scope Boxes.
