# Dynamo graph ImageInvert2.dyn (Dynamo 1.2.1.3083)

python_script = Python()  # unwired: IN[0]
# ---------- python_script.python (23 lines) ----------
import clr
clr.AddReference('ProtoGeometry')
from Autodesk.DesignScript.Geometry import *
#The inputs to this node will be stored as a list in the IN variables.
dataEnteringNode = IN

import sys
pyt_path = r"C:\Program Files (x86)\IronPython 2.7\Lib"
sys.path.append(pyt_path)
import os

imagePath = r"C:\Python\Revit3DPrint\image"
#imagename = "slice141.png"
#sys.path.append(imagePath)

os.system("python invertImages.py imagePath imageName")


# some code here

#pid = subprocess.Popen([sys.executable, "longtask.py"])

#Assign your output to the OUT variable.
# ----------------------------------------
