# Dynamo graph dynamicViewRange_2.dyn (Dynamo 1.2.1.3083)

current = Document.Current()
activeView = Document.ActiveView(current)
string = StringInput("C:\Python\Revit3DPrint\image\")
string_2 = StringInput("top-cut")
# note: bottom height (in inch)
# top height
# voxel size
# view range height
code_block = CodeBlock { 0 * 12; 115 * 12; 1; 12 / 12; }
python_script = Python(IN[0]=activeView, IN[1]=string, IN[2]=string_2, IN[3]=code_block.out0, IN[4]=code_block.out1, IN[5]=code_block.out2, IN[6]=code_block.out3)
# ---------- python_script.python (89 lines) ----------
import clr
clr.AddReference('ProtoGeometry')
from Autodesk.DesignScript.Geometry import *

# Import Element wrapper extension methods
clr.AddReference('RevitNodes')
import Revit
clr.ImportExtensions(Revit.Elements)

# Import geometry conversion extension methods
clr.ImportExtensions(Revit.GeometryConversion)

# Import DocumentManager and TransactionManager
clr.AddReference('RevitServices')
import RevitServices
from RevitServices.Persistence import DocumentManager
from RevitServices.Transactions import TransactionManager

# Import RevitAPI
clr.AddReference('RevitAPI')
import Autodesk
from Autodesk.Revit.DB import *

import System
from System import Array
from System.Collections.Generic import *

import sys

view = UnwrapElement(IN[0])
filePath = IN[1]
direction = IN[2]

bottom = IN[3]
top = IN[4]
voxel_size = IN[5]
depth = IN[6]
doc = DocumentManager.Instance.CurrentDBDocument


def setCutBottomPlane(height, depth, direction):  # convert inch to foot	
	viewRange = view.GetViewRange()
	if direction == 'cut-bottom':
		viewRange.SetOffset(PlanViewPlane.CutPlane, height / 12)
		viewRange.SetOffset(PlanViewPlane.BottomClipPlane, (height - depth) / 12)
		viewRange.SetOffset(PlanViewPlane.ViewDepthPlane, (height - depth) / 12)
		view.SetViewRange(viewRange)
	elif direction == 'top-cut':
		viewRange.SetOffset(PlanViewPlane.TopClipPlane, height / 12.0)
		viewRange.SetOffset(PlanViewPlane.CutPlane, height / 12.0)
		viewRange.SetOffset(PlanViewPlane.BottomClipPlane, (height - depth) / 12)
		viewRange.SetOffset(PlanViewPlane.ViewDepthPlane, (height - depth) / 12)
		view.SetViewRange(viewRange)


def exportViewImage(path, pixel_size):
	ieo = ImageExportOptions()
	ieo.FilePath = path	
	ieo.HLRandWFViewsFileType = ImageFileType.PNG
	ieo.ShadowViewsFileType = ImageFileType.PNG
	ieo.PixelSize = pixel_size
	doc.ExportImage(ieo)
	

bbox = view.CropBox
pixel_size = (bbox.Max.X - bbox.Min.X) * 12 * voxel_size
try:
	pre_i = 0 # slow issue: delete the first picture
	pre_j = 0
	count = -1
	transaction = Transaction(doc, 'transaction123')
	digit = len(str(int((top - bottom) / voxel_size)))
	
	height = bottom
	while height < top:
		height += voxel_size
		transaction.Start()
		setCutBottomPlane(height, depth, direction)
		imageName = filePath + str(count).rjust(digit)
		exportViewImage(imageName, pixel_size)
		
		transaction.Commit()
		count += 1
			
	OUT = "Success"
except Exception as e:
	OUT =  e
	
TransactionManager.Instance.TransactionTaskDone()
# ----------------------------------------
code_block_2 = CodeBlock {  }
